# Grasshopper definition MascaraCovid19Poli-Inflado-Ajustado.gh (Grasshopper 1.0.7)
# plug-ins: MeshEdit Components, Pufferfish, Weaverbird, Kangaroo2 Components, karambaGH

number_slider = Slider(49, range=20..100)
number_slider_2 = Slider(31, range=10..100)
radius_3 = Slider(13.209, range=10..40)
# Filtro
panel = Panel("1.1")
division = Division(A="7.7", B=2)
division_2 = Division(A="7.7", B=2)
max = Maximum(A=number_slider, B=number_slider_2)
subtraction = Subtraction(A=division_2, B=0.4)
ellipse = Ellipse(Plane=PlaneXY(0, 0, 0), Radius1=Slider(10.4, range=5..15), Radius2=Slider(7.9, range=5..30))  # -> Ellipse, Focus1, Focus2
ellipse_2 = Ellipse(Plane=PlaneXY(0, 0, 0), Radius1=number_slider, Radius2=number_slider_2)  # -> Ellipse, Focus1, Focus2
division_3 = Division(A=radius_3, B=number_slider_2)
Z = UnitZ(Factor=max)
ln = Line(StartPoint=ellipse_2.Focus1, EndPoint=ellipse_2.Focus2)
Z_2 = UnitZ(Factor=Slider(4.7, range=0..8.4))
Z_3 = UnitZ(Factor=Slider(2.7, range=0..8.4))
Z_4 = UnitZ(Factor=Slider(3.7, range=0..8.4))
Z_5 = UnitZ(Factor=Slider(5.7, range=0..8.4))
Z_6 = UnitZ(Factor=Slider(8.4, range=0..8.4))
Z_7 = UnitZ(Factor=Slider(4.6, range=0..8.4))
pt = Point(Point(0, 0, 0))
Z_8 = UnitZ(Factor=Slider(2.8, range=0..8.4))
Z_9 = UnitZ(Factor=Slider(3.8, range=0..8.4))
Z_10 = UnitZ(Factor=Slider(5.6, range=0..8.4))
Z_11 = UnitZ(Factor=Slider(8.4, range=0..8.4))
ext = ExtendCurve(Curve=ln, Type=0, Start=number_slider, End=number_slider)
multiplication = Multiplication(A=Z, B=1.5)
Y = UnitY(Factor=1)
cir = Circle(Plane=PlaneXY(0, 0, 0), Radius="1.5")
move = Move(Geometry=cir, Motion=Z_5)  # -> Geometry, Transform
cir_2 = Circle(Plane=PlaneXY(0, 0, 0), Radius=division)
move_2 = Move(Geometry=cir_2, Motion=Z_2)  # -> Geometry, Transform
move_3 = Move(Geometry=cir_2, Motion=Z_4)  # -> Geometry, Transform
move_4 = Move(Geometry=cir, Motion=Z_6)  # -> Geometry, Transform
cir_3 = Circle(Plane=PlaneXY(0, 0, 0), Radius=panel)
move_5 = Move(Geometry=cir_3, Motion=Z_3)  # -> Geometry, Transform
cir_4 = Circle(Plane=PlaneXY(0, 0, 0), Radius="1.1")
move_6 = Move(Geometry=cir_4, Motion=Z_10)  # -> Geometry, Transform
cir_5 = Circle(Plane=PlaneXY(0, 0, 0), Radius=subtraction)
move_7 = Move(Geometry=cir_5, Motion=Z_7)  # -> Geometry, Transform
move_8 = Move(Geometry=cir_5, Motion=Z_9)  # -> Geometry, Transform
move_9 = Move(Geometry=cir_4, Motion=Z_11)  # -> Geometry, Transform
cir_6 = Circle(Plane=PlaneXY(0, 0, 0), Radius=".7")
move_10 = Move(Geometry=cir_6, Motion=Z_8)  # -> Geometry, Transform
ccx = CurveCurve(CurveA=ellipse_2.Ellipse, CurveB=ext)  # -> Points, ParamsA, ParamsB
panel_2 = Panel("Pi")
line = LineSDL(Start=pt, Direction=Y, Length=1)
extr = Extrude(Base=ellipse.Ellipse, Direction=multiplication)
shatter = Shatter(Curve=ellipse_2.Ellipse, Parameters=ccx.ParamsA)
merge = Merge(
    Data1=cir_3,
    Data2=move_5.Geometry,
    Data3=move_3.Geometry,
    Data4=move_2.Geometry,
    Data5=move.Geometry,
    Data6=move_4.Geometry)
merge_2 = Merge(
    Data1=cir_6,
    Data2=move_10.Geometry,
    Data3=move_8.Geometry,
    Data4=move_7.Geometry,
    Data5=move_6.Geometry,
    Data6=move_9.Geometry)

# ---- group: Cilindro de corte
rotax = RotateAxis(Geometry=extr, Angle=degrees(Slider(77, range=0..90)), Axis=line)  # -> Geometry, Transform

# ----
item = ListItem(List=shatter, Index=0, Wrap=True)
revsrf = Revolution(Curve=item, Axis=ln, Domain=Domain(0, 6.283185307))
loft = Loft(Curves=merge, Options={Adjust=False, Closed=False, LoftEnds=0, LoftSimp=0, LoftType=3, Rebuild=10, Refit=0.01})
scale_nu = ScaleNU(Geometry=revsrf, Plane=PlaneXY(0, 0, 0), ScaleX=1, ScaleY=division_3, ScaleZ=1)  # -> Geometry, Transform
loft_2 = Loft(Curves=[cir_3, cir_6], Options={Adjust=False, Closed=False, LoftEnds=0, LoftSimp=0, LoftType=0, Rebuild=10, Refit=0.01})
loft_3 = Loft(Curves=merge_2, Options={Adjust=False, Closed=False, LoftEnds=0, LoftSimp=0, LoftType=3, Rebuild=10, Refit=0.01})
loft_4 = Loft(
    Curves=[move_4.Geometry, move_9.Geometry],
    Options={Adjust=False, Closed=False, LoftEnds=0, LoftSimp=0, LoftType=0, Rebuild=10, Refit=0.01})

# ---- group: Elipsoide da superficie
brep = Brep(scale_nu.Geometry)

# ----
split = SplitBrep(Brep=scale_nu.Geometry, Cutter=rotax.Geometry)  # -> reverse(Result)
merge_3 = Merge(Data1=loft_2, Data2=loft, Data3=loft_3, Data4=loft_4)
area = Area(Geometry=split)  # -> Area, Centroid
join = BrepJoin(Breps=merge_3)  # -> Breps, Closed
sort = SortList(Keys=area.Area, ValuesA=split, ValuesB=area.Centroid)  # -> Keys, ValuesA, ValuesB
item_2 = ListItem(List=sort.ValuesA, Index=0, Wrap=True)
item_3 = ListItem(List=sort.ValuesB, Index=0, Wrap=True)
# Infla
item_4 = ListItem(List=sort.ValuesA, Index=0, Wrap=True)
custom_mesh_settings = SettingsCustom(
    StitchSeams=True,
    SimplePlanes=False,
    Refine=True,
    MinCount=16,
    MaxCount=400,
    AspectRatio=20,
    MaxDistance=0,
    MaxAngle=20,
    MinEdge=0,
    MaxEdge=0)
srf = Surface(item_4)
mesh = MeshBrep(Brep=srf, Settings=custom_mesh_settings)

# ---- group: Reduzir número para inflar mais
number_slider_3 = Slider(0.355, range=0.1..1)

# ----
refine = Refine(Mesh=mesh, Level=1)
srf_2 = Surface(<surface referenced from the Rhino model>)
mesh_2 = Mesh(<mesh referenced from the Rhino model>)
flip = MeshFlip(Mesh=refine)
sdivide = DivideSurface(Surface=srf_2, UCount="5", VCount="100")  # -> Points, Normals, Parameters
flip_2 = FlipMatrix(Data=sdivide.Points)
pline = PolyLine(Vertices=flip_2, Closed=False)  # -> simplify(Polyline)
demesh = DeconstructMesh(Mesh=flip)  # -> Vertices, Faces, Colours, Normals
demesh_2 = DeconstructMesh(Mesh=mesh_2)  # -> Vertices, Faces, Colours, Normals
mesh_uv = MeshSurface(Surface=srf_2, UCount="5", VCount="100", Overhang=True, Equalize=False)
medges = MeshEdges(Mesh=mesh_uv)  # -> NakedEdges, InteriorEdges, NonManifoldEdges
len = Length(Curve=medges.NakedEdges)
vdis = VectorDisplay(Anchor=demesh.Vertices, Vector=demesh.Normals)
demesh_3 = DeconstructMesh(Mesh=mesh_uv)  # -> Vertices, Faces, Colours, Normals
larger = LargerThan(FirstNumber=len, SecondNumber="0.3")  # -> LargerThan, OrEqualTo
nv = NakedVertices(Mesh=flip)  # -> ClothedIndex, NakedIndex, ClothedPts, NakedPts
cull = CullPattern(List=medges.NakedEdges, CullPattern=larger.LargerThan)
join_2 = JoinCurves(Curves=cull, Preserve=False)
explode = Explode(Curve=join_2, Recursive=True)  # -> Segments, Vertices
edgelengths = EdgeLengths(Mesh=flip, LengthFactor=1, Strength=number_slider_3)
onmesh = OnMesh(Points=demesh_3.Vertices, Mesh=mesh_2, Strength=1)
pressure = Pressure(M=flip, Strength=0.01)
bang = ExplodeTree(Data=explode.Vertices)  # -> _0000, _0001
reset = Button()
show = Show(G=flip)
rdlines = RemoveDuplicateLinesKaramba3D(Line=explode.Segments, LimitDistance=0.005)  # -> OutLine, Info, Indexes
on = BooleanToggle(True)
edgelengths_2 = EdgeLengths(Mesh=mesh_uv, LengthFactor=Slider(1, range=1..2), Strength=Slider(1, range=0.1..1))
anchor = Anchor(Point=nv.NakedPts, Strength=10000)
show_2 = Show(G=mesh_uv)
reset_2 = Button()
panel_3 = Panel("30")
on_2 = BooleanToggle(False)
pt_2 = Point(bang._0000)
pdecon = Deconstruct(Point=pt_2)  # -> XComponent, YComponent, ZComponent
smaller = SmallerThan(FirstNumber=pdecon.XComponent, SecondNumber=Slider(-24, range=-60..10))  # -> SmallerThan, OrEqualTo
cull_2 = CullPattern(List=pt_2, CullPattern=smaller.SmallerThan)
pull = PullPoint(Point=cull_2, Geometry=demesh_2.Vertices, ClosestOnly=True)  # -> ClosestPoint, Distance
meshcp = MeshClosestPoint(Point=pull.ClosestPoint, Mesh=mesh_2)  # -> Point, Index, Parameter
meval = MeshEval(Mesh=mesh_2, Parameter=meshcp.Parameter)  # -> Point, Normal, Colour
vdis_2 = VectorDisplay(Anchor=meval.Point, Vector=meval.Normal)
not = GateNot(A=smaller.SmallerThan)
panel_4 = Panel("1000")
entwine = Entwine(Branch00=show, Branch01=[anchor, edgelengths, pressure], FlattenInputs=True)
cull_3 = CullPattern(List=bang._0001, CullPattern=smaller.SmallerThan)
rod = Rod(Polyline=pline, LengthFactor=1, AngleFactor="10", AxialStrength=10, BendStrength=Slider(50, range=0..50))  # -> flatten(R)
solver = Solver(GoalObjects=entwine, Reset=reset, Threshold=1e-15, Tolerance=0.01, On=on)  # -> I, V, O
anchor_2 = Anchor(Point=flatten(bang._0001), Strength=10000)  # disabled
Z_12 = UnitZ(Factor=1)
load = Load(Point=pt_2, ForceVector=Z_12, Weighting=Slider(0, range=-5..5))  # -> flatten(Unary)
bang_2 = ExplodeTree(Data=solver.O)  # -> Branch0, Branch1
offset = OffsetSurface(Surface=item_2, Distance=-0.3, Retrim=True)
grab = Grab(On=True, Strength=1, Range=3)
entwine_2 = Entwine(Branch00=show_2, Branch01=[edgelengths_2, onmesh, rod, load, anchor_2, grab], FlattenInputs=True)
xz = XZPlane(Origin=Point(0, 0, 0))
mesh_3 = Mesh(bang_2.Branch0)
edges = BrepEdges(Brep=item_2)  # -> Naked, Interior, NonManifold
edges_2 = BrepEdges(Brep=offset)  # -> Naked, Interior, NonManifold
demesh_4 = DeconstructMesh(Mesh=mesh_3)  # -> Vertices, Faces, Colours, Normals
medges_2 = MeshEdges(Mesh=mesh_3)  # -> NakedEdges, InteriorEdges, NonManifoldEdges
sec = BrepPlane(Brep=item_2, Plane=xz)  # -> Curves, Points
loft_5 = Loft(
    Curves=[edges_2.Naked, edges.Naked],
    Options={Adjust=False, Closed=False, LoftEnds=0, LoftSimp=0, LoftType=0, Rebuild=10, Refit=0.01})
lng = ListLength(List=flatten(demesh_4.Faces))
len_2 = Length(Curve=sec.Curves)
panel_5 = Panel(len_2)
join_3 = JoinCurves(Curves=medges_2.NakedEdges, Preserve=False)
join_4 = BrepJoin(Breps=[item_2, loft_5, offset])  # -> Breps, Closed
crv = Curve(medges_2.NakedEdges)
project = Project(Geometry=sec.Curves, Plane=PlaneXY(0, 0, 0))  # -> Geometry, Transform
solver_2 = Solver(GoalObjects=entwine_2, Reset=reset_2, Threshold=1e-15, Tolerance=0.01, On=on_2)  # -> I, V, O
len_3 = Length(Curve=join_3)
colour = ColourPicker(PickedColour=RGBA(130, 209, 209, 179))
expression = Expression(x=lng, y=Slider(0.51, range=0..1), Expression="int(x*y)")
pframes = PerpFrames(Curve=project.Geometry, Count="100", Align=True)  # -> Frames, Parameters
panel_6 = Panel(len_3)
bang_3 = ExplodeTree(Data=solver_2.O)  # -> Branch0, Branch1
sec_2 = BrepPlane(Brep=item_2, Plane=pframes.Frames)  # -> flatten(Curves), Points
divide = DivideCurve(Curve=edges.Naked, Count=10, Kinks=False)  # -> Points, Tangents, Parameters
redumsh = ReduceMesh(Mesh=mesh_3, FaceCount=expression, Accuracy=Slider(9, range=0..10), FaceType=0, Distort=True, Normalize=False)  # -> Reduced, CountDifference
mesh_4 = Mesh(bang_3.Branch0)
wblaplace = WeaverbirdsLaplacianSmoothing(MeshCurves=mesh_4, Level="2", SmoothNakedEdges=1, Thin=1)
plfit = PlaneFit(Points=divide.Points)  # -> Plane, Deviation
len_4 = Length(Curve=sec_2.Curves)
offset_2 = OffsetCurve(Curve=edges.Naked, Distance=-1, Plane=plfit.Plane, Corners=1)
medges_3 = MeshEdges(Mesh=wblaplace)  # -> NakedEdges, InteriorEdges, NonManifoldEdges
sort_2 = SortList(Keys=len_4, ValuesA=sec_2.Curves)  # -> reverse(Keys), reverse(ValuesA)
offmsh = OffsetMesh(Mesh=redumsh.Reduced, Distance="-.3", BothSides=False, CreateSolid=True)
loft_6 = Loft(
    Curves=flatten([edges.Naked, offset_2]),
    Options={Adjust=False, Closed=False, LoftEnds=0, LoftSimp=0, LoftType=0, Rebuild=10, Refit=0.01})
deplane = DeconstructPlane(Plane=plfit.Plane)  # -> Origin, XAxis, YAxis, ZAxis
crv_2 = Curve(medges_3.NakedEdges)
item_5 = ListItem(List=sort_2.Keys, Index=0, Wrap=True)
panel_7 = Panel(item_5)
item_6 = ListItem(List=sort_2.ValuesA, Index=0, Wrap=True)
join_5 = JoinCurves(Curves=crv_2, Preserve=False)
multiplication_2 = Multiplication(A=deplane.ZAxis, B=-3)
colour_2 = ColourPicker(PickedColour=RGBA(173, 199, 199, 127))
extr_2 = Extrude(Base=loft_6, Direction=multiplication_2)
explode_2 = Explode(Curve=join_5, Recursive=True)  # -> Segments, Vertices
intcrv = Interpolate(Vertices=explode_2.Vertices, Degree=3, Periodic=False, KnotStyle=1)  # -> Curve, Length, Domain
xy = XYPlane(Origin=Point(0, 0, 0))
orient = Orient(Geometry=offmsh, Source=plfit.Plane, Target=xy)  # -> Geometry, Transform
preview = CustomPreview(Geometry=orient.Geometry, Material=colour_2)  # disabled
rebcrv = RebuildCurve(Curve=intcrv.Curve, Count=Slider(58, range=20..100), EndTangents=False)  # -> flatten(Rebuilt)
orient_2 = Orient(Geometry=loft_6, Source=plfit.Plane, Target=xy)  # -> Geometry, Transform
preview_2 = CustomPreview(Geometry=orient_2.Geometry, Material=ColourSwatch(SwatchColor=RGB(191, 189, 65)))  # disabled
loft_7 = Loft(Curves=rebcrv, Options={Adjust=False, Closed=False, LoftEnds=0, LoftSimp=0, LoftType=0, Rebuild=10, Refit=0.01})
loft_8 = Loft(
    Curves=flatten([loft_7, loft_6]),
    Options={Adjust=False, Closed=False, LoftEnds=0, LoftSimp=0, LoftType=0, Rebuild=10, Refit=0.01})

# ---- group: Posiciona filtro no lugar certo
division_4 = Division(A=multiplication_2, B=2)
item_7 = ListItem(List=divide.Points, Index=Slider(5, range=0..10), Wrap=True)
move_11 = Move(Geometry=item_7, Motion=division_4)  # -> Geometry, Transform
multiplication_3 = Multiplication(A=deplane.XAxis, B=Slider(0.6, range=0..1))
move_12 = Move(Geometry=move_11.Geometry, Motion=multiplication_3)  # -> Geometry, Transform
pl = ConstructPlane(Origin=move_12.Geometry, XAxis=deplane.YAxis, YAxis=deplane.ZAxis)
orient_3 = Orient(Geometry=join.Breps, Source=PlaneXY(0, 0, 0), Target=PlaneXY(0, 0, 0))  # -> Geometry, Transform

# ----
vrot = Rotate(Vector=deplane.ZAxis, Axis=deplane.YAxis, Angle=Slider(0.47, range=0..1))
pl_2 = ConstructPlane(Origin=move_12.Geometry, XAxis=deplane.YAxis, YAxis=vrot)
preview_3 = CustomPreview(Geometry=orient_3.Geometry, Material=ColourSwatch(SwatchColor=RGBA(57, 219, 165, 167)))  # disabled
