# Grasshopper definition MascaraCovid19Poli-Inflado.gh (Grasshopper 1.0.7)
# plug-ins: MeshEdit Components, Pufferfish, Kangaroo2 Components

number_slider = Slider(49, range=20..100)
number_slider_2 = Slider(31, range=10..100)
radius_3 = Slider(13.209, range=10..40)
# Filtro
panel = Panel("1.1")
division = Division(A="7.7", B=2)
division_2 = Division(A="7.7", B=2)
max = Maximum(A=number_slider, B=number_slider_2)
subtraction = Subtraction(A=division_2, B=0.4)
ellipse = Ellipse(Plane=PlaneXY(0, 0, 0), Radius1=Slider(9.4, range=5..15), Radius2=Slider(7, range=5..30))  # -> Ellipse, Focus1, Focus2
ellipse_2 = Ellipse(Plane=PlaneXY(0, 0, 0), Radius1=number_slider, Radius2=number_slider_2)  # -> Ellipse, Focus1, Focus2
division_3 = Division(A=radius_3, B=number_slider_2)
Z = UnitZ(Factor=max)
ln = Line(StartPoint=ellipse_2.Focus1, EndPoint=ellipse_2.Focus2)
Z_2 = UnitZ(Factor=Slider(4.7, range=0..8.4))
Z_3 = UnitZ(Factor=Slider(2.7, range=0..8.4))
Z_4 = UnitZ(Factor=Slider(3.7, range=0..8.4))
Z_5 = UnitZ(Factor=Slider(5.7, range=0..8.4))
Z_6 = UnitZ(Factor=Slider(8.4, range=0..8.4))
Z_7 = UnitZ(Factor=Slider(4.6, range=0..8.4))
pt = Point(Point(0, 0, 0))
Z_8 = UnitZ(Factor=Slider(2.8, range=0..8.4))
Z_9 = UnitZ(Factor=Slider(3.8, range=0..8.4))
Z_10 = UnitZ(Factor=Slider(5.6, range=0..8.4))
Z_11 = UnitZ(Factor=Slider(8.4, range=0..8.4))
ext = ExtendCurve(Curve=ln, Type=0, Start=number_slider, End=number_slider)
multiplication = Multiplication(A=Z, B=1.5)
Y = UnitY(Factor=1)
cir = Circle(Plane=PlaneXY(0, 0, 0), Radius="1.5")
move = Move(Geometry=cir, Motion=Z_5)  # -> Geometry, Transform
cir_2 = Circle(Plane=PlaneXY(0, 0, 0), Radius=division)
move_2 = Move(Geometry=cir_2, Motion=Z_2)  # -> Geometry, Transform
move_3 = Move(Geometry=cir_2, Motion=Z_4)  # -> Geometry, Transform
move_4 = Move(Geometry=cir, Motion=Z_6)  # -> Geometry, Transform
cir_3 = Circle(Plane=PlaneXY(0, 0, 0), Radius=panel)
move_5 = Move(Geometry=cir_3, Motion=Z_3)  # -> Geometry, Transform
cir_4 = Circle(Plane=PlaneXY(0, 0, 0), Radius="1.1")
move_6 = Move(Geometry=cir_4, Motion=Z_10)  # -> Geometry, Transform
cir_5 = Circle(Plane=PlaneXY(0, 0, 0), Radius=subtraction)
move_7 = Move(Geometry=cir_5, Motion=Z_7)  # -> Geometry, Transform
move_8 = Move(Geometry=cir_5, Motion=Z_9)  # -> Geometry, Transform
move_9 = Move(Geometry=cir_4, Motion=Z_11)  # -> Geometry, Transform
cir_6 = Circle(Plane=PlaneXY(0, 0, 0), Radius=".7")
move_10 = Move(Geometry=cir_6, Motion=Z_8)  # -> Geometry, Transform
ccx = CurveCurve(CurveA=ellipse_2.Ellipse, CurveB=ext)  # -> Points, ParamsA, ParamsB
panel_2 = Panel("Pi")
line = LineSDL(Start=pt, Direction=Y, Length=1)
extr = Extrude(Base=ellipse.Ellipse, Direction=multiplication)
shatter = Shatter(Curve=ellipse_2.Ellipse, Parameters=ccx.ParamsA)
merge = Merge(
    Data1=cir_3,
    Data2=move_5.Geometry,
    Data3=move_3.Geometry,
    Data4=move_2.Geometry,
    Data5=move.Geometry,
    Data6=move_4.Geometry)
merge_2 = Merge(
    Data1=cir_6,
    Data2=move_10.Geometry,
    Data3=move_8.Geometry,
    Data4=move_7.Geometry,
    Data5=move_6.Geometry,
    Data6=move_9.Geometry)

# ---- group: Cilindro de corte
rotax = RotateAxis(Geometry=extr, Angle=degrees(Slider(76, range=0..90)), Axis=line)  # -> Geometry, Transform

# ----
item = ListItem(List=shatter, Index=0, Wrap=True)
revsrf = Revolution(Curve=item, Axis=ln, Domain=Domain(0, 6.283185307))
loft = Loft(Curves=merge, Options={Adjust=False, Closed=False, LoftEnds=0, LoftSimp=0, LoftType=3, Rebuild=10, Refit=0.01})
scale_nu = ScaleNU(Geometry=revsrf, Plane=PlaneXY(0, 0, 0), ScaleX=1, ScaleY=division_3, ScaleZ=1)  # -> Geometry, Transform
loft_2 = Loft(Curves=[cir_3, cir_6], Options={Adjust=False, Closed=False, LoftEnds=0, LoftSimp=0, LoftType=0, Rebuild=10, Refit=0.01})
loft_3 = Loft(Curves=merge_2, Options={Adjust=False, Closed=False, LoftEnds=0, LoftSimp=0, LoftType=3, Rebuild=10, Refit=0.01})
loft_4 = Loft(
    Curves=[move_4.Geometry, move_9.Geometry],
    Options={Adjust=False, Closed=False, LoftEnds=0, LoftSimp=0, LoftType=0, Rebuild=10, Refit=0.01})

# ---- group: Elipsoide da superficie
brep = Brep(scale_nu.Geometry)

# ----
split = SplitBrep(Brep=scale_nu.Geometry, Cutter=rotax.Geometry)  # -> reverse(Result)
merge_3 = Merge(Data1=loft_2, Data2=loft, Data3=loft_3, Data4=loft_4)
area = Area(Geometry=split)  # -> Area, Centroid
join = BrepJoin(Breps=merge_3)  # -> Breps, Closed
sort = SortList(Keys=area.Area, ValuesA=split, ValuesB=area.Centroid)  # -> Keys, ValuesA, ValuesB
item_2 = ListItem(List=sort.ValuesA, Index=0, Wrap=True)
item_3 = ListItem(List=sort.ValuesB, Index=0, Wrap=True)
# Infla
item_4 = ListItem(List=sort.ValuesA, Index=0, Wrap=True)
custom_mesh_settings = SettingsCustom(
    StitchSeams=True,
    SimplePlanes=False,
    Refine=True,
    MinCount=16,
    MaxCount=400,
    AspectRatio=20,
    MaxDistance=0,
    MaxAngle=20,
    MinEdge=0,
    MaxEdge=0)
srf = Surface(item_4)
mesh = MeshBrep(Brep=srf, Settings=custom_mesh_settings)

# ---- group: Reduzir número para inflar mais
number_slider_3 = Slider(0.355, range=0.1..1)

# ----
refine = Refine(Mesh=mesh, Level=1)
flip = MeshFlip(Mesh=refine)
demesh = DeconstructMesh(Mesh=flip)  # -> Vertices, Faces, Colours, Normals
vdis = VectorDisplay(Anchor=demesh.Vertices, Vector=demesh.Normals)
nv = NakedVertices(Mesh=flip)  # -> ClothedIndex, NakedIndex, ClothedPts, NakedPts
edgelengths = EdgeLengths(Mesh=flip, LengthFactor=1, Strength=number_slider_3)
pressure = Pressure(M=flip, Strength=0.01)
reset = Button()
show = Show(G=flip)
on = BooleanToggle(True)
anchor = Anchor(Point=nv.NakedPts, Strength=10000)
entwine = Entwine(Branch00=show, Branch01=[anchor, edgelengths, pressure], FlattenInputs=True)
solver = Solver(GoalObjects=entwine, Reset=reset, Threshold=1e-15, Tolerance=0.01, On=on)  # -> I, V, O
bang = ExplodeTree(Data=solver.O)  # -> Branch0, Branch1
offset = OffsetSurface(Surface=item_2, Distance=-0.3, Retrim=True)
xz = XZPlane(Origin=Point(0, 0, 0))
mesh_2 = Mesh(bang.Branch0)
edges = BrepEdges(Brep=item_2)  # -> Naked, Interior, NonManifold
edges_2 = BrepEdges(Brep=offset)  # -> Naked, Interior, NonManifold
demesh_2 = DeconstructMesh(Mesh=mesh_2)  # -> Vertices, Faces, Colours, Normals
medges = MeshEdges(Mesh=mesh_2)  # -> NakedEdges, InteriorEdges, NonManifoldEdges
sec = BrepPlane(Brep=item_2, Plane=xz)  # -> Curves, Points
loft_5 = Loft(
    Curves=[edges_2.Naked, edges.Naked],
    Options={Adjust=False, Closed=False, LoftEnds=0, LoftSimp=0, LoftType=0, Rebuild=10, Refit=0.01})
lng = ListLength(List=flatten(demesh_2.Faces))
len = Length(Curve=sec.Curves)
panel_3 = Panel(len)
join_2 = JoinCurves(Curves=medges.NakedEdges, Preserve=False)
join_3 = BrepJoin(Breps=[item_2, loft_5, offset])  # -> Breps, Closed
crv = Curve(medges.NakedEdges)
project = Project(Geometry=sec.Curves, Plane=PlaneXY(0, 0, 0))  # -> Geometry, Transform
len_2 = Length(Curve=join_2)
colour = ColourPicker(PickedColour=RGBA(130, 209, 209, 179))
expression = Expression(x=lng, y=Slider(0.51, range=0..1), Expression="int(x*y)")
pframes = PerpFrames(Curve=project.Geometry, Count="100", Align=True)  # -> Frames, Parameters
panel_4 = Panel(len_2)
sec_2 = BrepPlane(Brep=item_2, Plane=pframes.Frames)  # -> flatten(Curves), Points
divide = DivideCurve(Curve=edges.Naked, Count=10, Kinks=False)  # -> Points, Tangents, Parameters
redumsh = ReduceMesh(Mesh=mesh_2, FaceCount=expression, Accuracy=Slider(9, range=0..10), FaceType=0, Distort=True, Normalize=False)  # -> Reduced, CountDifference
preview = CustomPreview(Geometry=join_3.Breps, Material=colour)
len_3 = Length(Curve=sec_2.Curves)
plfit = PlaneFit(Points=divide.Points)  # -> Plane, Deviation
offset_2 = OffsetCurve(Curve=edges.Naked, Distance=-1, Plane=plfit.Plane, Corners=1)
sort_2 = SortList(Keys=len_3, ValuesA=sec_2.Curves)  # -> reverse(Keys), reverse(ValuesA)
offmsh = OffsetMesh(Mesh=redumsh.Reduced, Distance="-.3", BothSides=False, CreateSolid=True)
loft_6 = Loft(
    Curves=flatten([edges.Naked, offset_2]),
    Options={Adjust=False, Closed=False, LoftEnds=0, LoftSimp=0, LoftType=0, Rebuild=10, Refit=0.01})
deplane = DeconstructPlane(Plane=plfit.Plane)  # -> Origin, XAxis, YAxis, ZAxis
item_5 = ListItem(List=sort_2.Keys, Index=0, Wrap=True)
panel_5 = Panel(item_5)
item_6 = ListItem(List=sort_2.ValuesA, Index=0, Wrap=True)
multiplication_2 = Multiplication(A=deplane.ZAxis, B=-3)
colour_2 = ColourPicker(PickedColour=RGBA(173, 199, 199, 179))
extr_2 = Extrude(Base=loft_6, Direction=multiplication_2)
preview_2 = CustomPreview(Geometry=offmsh, Material=colour_2)
preview_3 = CustomPreview(Geometry=extr_2, Material=ColourSwatch(SwatchColor=RGB(191, 189, 65)))
vrot = Rotate(Vector=deplane.ZAxis, Axis=deplane.YAxis, Angle=Slider(0.31, range=0..1))

# ---- group: Posiciona filtro no lugar certo
division_4 = Division(A=multiplication_2, B=2)
item_7 = ListItem(List=divide.Points, Index=Slider(5, range=0..10), Wrap=True)
move_11 = Move(Geometry=item_7, Motion=division_4)  # -> Geometry, Transform
multiplication_3 = Multiplication(A=deplane.XAxis, B=Slider(0.6, range=0..1))
move_12 = Move(Geometry=move_11.Geometry, Motion=multiplication_3)  # -> Geometry, Transform
pl = ConstructPlane(Origin=move_12.Geometry, XAxis=deplane.YAxis, YAxis=deplane.ZAxis)

# ----
pl_2 = ConstructPlane(Origin=move_12.Geometry, XAxis=deplane.YAxis, YAxis=vrot)

# ---- group: Posiciona filtro no lugar certo (continued)
orient = Orient(Geometry=join.Breps, Source=PlaneXY(0, 0, 0), Target=pl_2)  # -> Geometry, Transform

# ----
preview_4 = CustomPreview(Geometry=orient.Geometry, Material=ColourSwatch(SwatchColor=RGBA(57, 219, 165, 167)))
