# Grasshopper definition MascaraCovid19Poli-Inflate.gh (Grasshopper 1.0.7)
# plug-ins: MeshEdit Components, Weaverbird, Kangaroo2 Components

radius_3 = Slider(14.5, range=10..40)
number_slider = Slider(28, range=10..40)
ellipse = Ellipse(Plane=PlaneXY(0, 0, 0), Radius1=Slider(8.5, range=5..15), Radius2=Slider(7.2, range=5..30))  # -> Ellipse, Focus1, Focus2
ellipse_2 = Ellipse(Plane=PlaneXY(0, 0, 0), Radius1=Slider(48, range=20..50), Radius2=number_slider)  # -> Ellipse, Focus1, Focus2
division = Division(A=radius_3, B=number_slider)
Z = UnitZ(Factor=number_slider)
ln = Line(StartPoint=ellipse_2.Focus1, EndPoint=ellipse_2.Focus2)
pt = Point(Point(0, 0, 0))
ext = ExtendCurve(Curve=ln, Type=0, Start="10", End="10")
multiplication = Multiplication(A=Z, B=1.5)
Y = UnitY(Factor=1)
ccx = CurveCurve(CurveA=ellipse_2.Ellipse, CurveB=ext)  # -> Points, ParamsA, ParamsB
panel = Panel("Pi")
line = LineSDL(Start=pt, Direction=Y, Length=1)
extr = Extrude(Base=ellipse.Ellipse, Direction=multiplication)
shatter = Shatter(Curve=ellipse_2.Ellipse, Parameters=ccx.ParamsA)
rotax = RotateAxis(Geometry=extr, Angle=degrees(Slider(45, range=0..45)), Axis=line)  # -> Geometry, Transform
item = ListItem(List=shatter, Index=0, Wrap=True)
revsrf = Revolution(Curve=item, Axis=ln, Domain=Domain(0, 6.283185307))
scale_nu = ScaleNU(Geometry=revsrf, Plane=PlaneXY(0, 0, 0), ScaleX=1, ScaleY=division, ScaleZ=1)  # -> Geometry, Transform
split = SplitBrep(Brep=scale_nu.Geometry, Cutter=rotax.Geometry)  # -> reverse(Result)
area = Area(Geometry=split)  # -> Area, Centroid
sort = SortList(Keys=area.Area, ValuesA=split, ValuesB=area.Centroid)  # -> Keys, ValuesA, ValuesB
custom_mesh_settings = SettingsCustom(
    StitchSeams=True,
    SimplePlanes=False,
    Refine=True,
    MinCount=16,
    MaxCount=400,
    AspectRatio=20,
    MaxDistance=0,
    MaxAngle=20,
    MinEdge=0,
    MaxEdge=0)
item_2 = ListItem(List=sort.ValuesA, Index=0, Wrap=True)
item_3 = ListItem(List=sort.ValuesB, Index=0, Wrap=True)
srf = Surface(item_2)
xz = XZPlane(Origin=Point(0, 0, 0))
preview = CustomPreview(
    Geometry=item_2,
    Material={diffuse=RGB(221, 160, 221), emission=RGB(66, 48, 66), shine=0.5, specular=RGB(255, 255, 255), transparency=0})
mesh = MeshBrep(Brep=srf, Settings=custom_mesh_settings)

# ---- group: Reduzir número para inflar mais
number_slider_2 = Slider(0.187, range=0.1..1)

# ----
sec = BrepPlane(Brep=item_2, Plane=xz)  # -> Curves, Points
wbcatmullclark = WeaverbirdsCatmullClarkSubdivision(MeshCurves=mesh, Level=Slider(1, range=0..5), SmoothNakedEdges=1)
len = Length(Curve=sec.Curves)
panel_2 = Panel(len)
project = Project(Geometry=sec.Curves, Plane=PlaneXY(0, 0, 0))  # -> Geometry, Transform
flip = MeshFlip(Mesh=wbcatmullclark)
demesh = DeconstructMesh(Mesh=flip)  # -> Vertices, Faces, Colours, Normals
pframes = PerpFrames(Curve=project.Geometry, Count="100", Align=True)  # -> Frames, Parameters
vdis = VectorDisplay(Anchor=demesh.Vertices, Vector=demesh.Normals)
sec_2 = BrepPlane(Brep=item_2, Plane=pframes.Frames)  # -> flatten(Curves), Points
nv = NakedVertices(Mesh=flip)  # -> ClothedIndex, NakedIndex, ClothedPts, NakedPts
len_2 = Length(Curve=sec_2.Curves)
edgelengths = EdgeLengths(Mesh=flip, LengthFactor=1, Strength=number_slider_2)
pressure = Pressure(M=flip, Strength=0.01)
reset = Button()
show = Show(G=flip)
on = BooleanToggle(True)
anchor = Anchor(Point=nv.NakedPts, Strength=10000)
sort_2 = SortList(Keys=len_2, ValuesA=sec_2.Curves)  # -> reverse(Keys), reverse(ValuesA)
item_4 = ListItem(List=sort_2.ValuesA, Index=0, Wrap=True)
item_5 = ListItem(List=sort_2.Keys, Index=0, Wrap=True)
panel_3 = Panel(item_5)
entwine = Entwine(Branch00=show, Branch01=[anchor, edgelengths, pressure], FlattenInputs=True)
solver = Solver(GoalObjects=entwine, Reset=reset, Threshold=1e-15, Tolerance=0.01, On=on)  # -> I, V, O
bang = ExplodeTree(Data=solver.O)  # -> Branch0, Branch1
mesh_2 = Mesh(bang.Branch0)
