# Grasshopper definition MascaraCovid19Poli.gh (Grasshopper 1.0.7)

number_slider = Slider(49, range=20..100)
number_slider_2 = Slider(31, range=10..100)
radius_3 = Slider(13.209, range=10..40)
max = Maximum(A=number_slider, B=number_slider_2)
ellipse = Ellipse(Plane=PlaneXY(0, 0, 0), Radius1=Slider(9.4, range=5..15), Radius2=Slider(7, range=5..30))  # -> Ellipse, Focus1, Focus2
ellipse_2 = Ellipse(Plane=PlaneXY(0, 0, 0), Radius1=number_slider, Radius2=number_slider_2)  # -> Ellipse, Focus1, Focus2
division = Division(A=radius_3, B=number_slider_2)
Z = UnitZ(Factor=max)
ln = Line(StartPoint=ellipse_2.Focus1, EndPoint=ellipse_2.Focus2)
pt = Point(Point(0, 0, 0))
ext = ExtendCurve(Curve=ln, Type=0, Start=number_slider, End=number_slider)
multiplication = Multiplication(A=Z, B=1.5)
Y = UnitY(Factor=1)
ccx = CurveCurve(CurveA=ellipse_2.Ellipse, CurveB=ext)  # -> Points, ParamsA, ParamsB
panel = Panel("Pi")
line = LineSDL(Start=pt, Direction=Y, Length=1)
extr = Extrude(Base=ellipse.Ellipse, Direction=multiplication)
shatter = Shatter(Curve=ellipse_2.Ellipse, Parameters=ccx.ParamsA)
rotax = RotateAxis(Geometry=extr, Angle=degrees(Slider(76, range=0..90)), Axis=line)  # -> Geometry, Transform
item = ListItem(List=shatter, Index=0, Wrap=True)
revsrf = Revolution(Curve=item, Axis=ln, Domain=Domain(0, 6.283185307))
scale_nu = ScaleNU(Geometry=revsrf, Plane=PlaneXY(0, 0, 0), ScaleX=1, ScaleY=division, ScaleZ=1)  # -> Geometry, Transform
brep = Brep(scale_nu.Geometry)
split = SplitBrep(Brep=scale_nu.Geometry, Cutter=rotax.Geometry)  # -> reverse(Result)
area = Area(Geometry=split)  # -> Area, Centroid
sort = SortList(Keys=area.Area, ValuesA=split, ValuesB=area.Centroid)  # -> Keys, ValuesA, ValuesB
item_2 = ListItem(List=sort.ValuesA, Index=0, Wrap=True)
item_3 = ListItem(List=sort.ValuesB, Index=0, Wrap=True)
xz = XZPlane(Origin=Point(0, 0, 0))
offset = OffsetSurface(Surface=item_2, Distance=-0.3, Retrim=True)
edges = BrepEdges(Brep=item_2)  # -> Naked, Interior, NonManifold
edges_2 = BrepEdges(Brep=offset)  # -> Naked, Interior, NonManifold
sec = BrepPlane(Brep=item_2, Plane=xz)  # -> Curves, Points
loft = Loft(
    Curves=[edges_2.Naked, edges.Naked],
    Options={Adjust=False, Closed=False, LoftEnds=0, LoftSimp=0, LoftType=0, Rebuild=10, Refit=0.01})
len = Length(Curve=sec.Curves)
panel_2 = Panel(len)
join = BrepJoin(Breps=[item_2, loft, offset])  # -> Breps, Closed
project = Project(Geometry=sec.Curves, Plane=PlaneXY(0, 0, 0))  # -> Geometry, Transform
colour = ColourPicker(PickedColour=RGBA(94, 219, 219, 179))
pframes = PerpFrames(Curve=project.Geometry, Count="100", Align=True)  # -> Frames, Parameters
sec_2 = BrepPlane(Brep=item_2, Plane=pframes.Frames)  # -> flatten(Curves), Points
divide = DivideCurve(Curve=edges.Naked, Count=10, Kinks=False)  # -> Points, Tangents, Parameters
preview = CustomPreview(Geometry=join.Breps, Material=colour)
len_2 = Length(Curve=sec_2.Curves)
plfit = PlaneFit(Points=divide.Points)  # -> Plane, Deviation
offset_2 = OffsetCurve(Curve=edges.Naked, Distance=-1, Plane=plfit.Plane, Corners=1)
sort_2 = SortList(Keys=len_2, ValuesA=sec_2.Curves)  # -> reverse(Keys), reverse(ValuesA)
loft_2 = Loft(
    Curves=flatten([edges.Naked, offset_2]),
    Options={Adjust=False, Closed=False, LoftEnds=0, LoftSimp=0, LoftType=0, Rebuild=10, Refit=0.01})
deplane = DeconstructPlane(Plane=plfit.Plane)  # -> Origin, XAxis, YAxis, ZAxis
item_4 = ListItem(List=sort_2.Keys, Index=0, Wrap=True)
panel_3 = Panel(item_4)
item_5 = ListItem(List=sort_2.ValuesA, Index=0, Wrap=True)
multiplication_2 = Multiplication(A=deplane.ZAxis, B=-3)
extr_2 = Extrude(Base=loft_2, Direction=multiplication_2)
preview_2 = CustomPreview(Geometry=extr_2, Material=ColourSwatch(SwatchColor=RGB(191, 189, 65)))
